# Grasshopper definition HVACSystemWorkflow.gh (Grasshopper 0.9.76)
# plug-ins: Python Interpreter, Ironbug.Grasshopper

brep = Brep()
brep_2 = Brep([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])
honeybee = Honeybee_Honeybee()  # -> Vviiiiiiiiiizzz; plug-in component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
ladybug = Ladybug_Ladybug()  # -> Vviiiiiiiiiizzz; plug-in component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
intersectmass = IntersectMass(x=brep_2)  # -> out, A; inputs x: list of Brep
# ---------- intersectmass: C# ----------
    var tolerance = Rhino.RhinoDoc.ActiveDoc.ModelAbsoluteTolerance;
    List<Brep> allOldBreps = x;

    if (x.Count() > 0)
    {
      var results = allOldBreps.AsParallel().AsOrdered().Select(b => SplitBrepWithBreps(b, allOldBreps, tolerance));
      A = results;
    }

    //SplitBrepWithBreps(x[0], x, tolerance);
# ---------- intersectmass: C# additional code ----------
  static Brep SplitBrepWithBreps(Brep CurrentBrep, List<Brep> AllBreps, double tolerance)
  {
    var currentBrep = CurrentBrep;
    var allBreps = AllBreps;

    foreach (Brep item in allBreps)
    {
      var  tempBrep = currentBrep.Split(item, tolerance);
      if (tempBrep.Count() > 0)
      {
        var newBrep = Rhino.Geometry.Brep.JoinBreps(tempBrep, tolerance);

        currentBrep = newBrep.First();
        currentBrep.Faces.ShrinkFaces();
      }
    }
    return currentBrep;

  }
# ---------- end intersectmass ----------
number_slider = Slider(0.7, range=0..1)
mass2zone = Honeybee_Masses2Zones(zoneMasses=flatten(intersectmass.A), maxRoofAngle=30, createHBZones=Toggle(True))  # -> readMe, HBZones; plug-in component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
panel = Panel("https://www.energyplus.net/weather-download/north_and_central_america_wmo_region_4/USA/NY/USA_NY_New.York-LaGuardia.AP.725030_TMY3/all")
glzparamlist = Honeybee_GlazingParametersList(northGlzParam=0, westGlzParam=0, southGlzParam=number_slider, eastGlzParam=number_slider)  # -> glzParamList; plug-in component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
panel_2 = Panel("DifferentialDryBulb")
solveadjc = Honeybee_SolveAdjacencies(HBZones=flatten(mass2zone.HBZones), removeCurrentAdjc=False, findAdjc=Toggle(True))  # -> readMe, HBZonesWADJ; plug-in component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
glazingcreator = Honeybee_GlazingBasedOnRatio(HBObjects=solveadjc.HBZonesWADJ, glzRatio=glzparamlist, runIt=Toggle(True))  # -> readMe, HBObjWGLZ; plug-in component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
data = Data(flatten(glazingcreator.HBObjWGLZ))
separatezonesbyfloor = Honeybee_SeparateZonesByFloor(HBZones=flatten(data))  # -> floorHeights, HBZones; plug-in component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
epw_stat = Ladybug_OpenEPWAndSTATWeatherFiles(weatherFileURL=panel)  # -> epwFile, statFile; plug-in component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
hvactemplate = Ironbug_HVACTemplate()

# ----
# HBZones
data_2 = Data()

hvacsystemslist = Honeybee_HVACSystemsList({"-1. Thermostat Only": -1, "0. Ideal Air Loads": 0, "1. PTAC | Residential": 1, "2. PTHP | Residential": 2, "3. Packaged Single Zone - AC": 3, "4. Packaged Single Zone - HP": 4, "5. Packaged VAV w/ Reheat": 5, "6. Packaged VAV w/ PFP Boxes": 6, "7. VAV w/ Reheat": 7, "8. VAV w/ PFP Boxes": 8, "9. Warm Air Furnace - Gas Fired": 9, "10.Warm Air Furnace - Electric": 10, "11.Fan Coil Units + DOAS": 11, "12.Active Chilled Beams + DOAS": 12, "13.Radiant Floors + DOAS": 13, "14.Custom Rad Surfaces + DOAS": 14, "15.Heated Surfaces + VAV Cooling": 15, "16.VRF + DOAS": 16, "17.WSHP + DOAS": 17}, selected="4. Packaged Single Zone - HP")
hvacsystem = Honeybee_AssignHVACSystem(HBZones=graft(glazingcreator.HBObjWGLZ), HVACSystems=hvacsystemslist)  # -> readMe, HBZones; plug-in component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
coilhtngas = Ironbug_CoilHeatingGas()
coilclndx1 = Ironbug_CoilCoolingDXSingleSpeed()

# ----
# Sys03_SZAC
# Airloop
panel_3 = Panel("DifferentialDryBulb")
lng = ListLength(List=data_2)
diffuser = Ironbug_AirTerminalSingleDuctUncontrolled()
objparams = Ironbug_ObjParams(EconomizerControlType=panel_3, DataFieldSetType="Ironbug.HVAC.IB_ControllerOutdoorAir_DataFieldSet")
duplicate = Ironbug_Duplicate(Reference=diffuser, Amount=lng)  # -> Objects, graft(port)
objparams_2 = Ironbug_ObjParams(PressureRise="500", DataFieldSetType="Ironbug.HVAC.IB_FanConstantVolume_DataFields")
oacontroller = Ironbug_OAController()
thermalzone = Ironbug_ThermalZone(HoneybeeZonesOrOsZones=data_2, AirTerminal_=duplicate.Objects, IsAirTerminalPriorToZoneEquipments=True)
oasystem = Ironbug_OutdoorAirSystem(Controller_=oacontroller)
fanconstant = Ironbug_FanConstantVolume(Parameters=objparams_2)
graft = GraftTree(Tree=thermalzone, IncludeEmptyLists=True, IncludeNullItems=True)
lng_2 = ListLength(List=thermalzone)
objparams_3 = Ironbug_ObjParams(
    AllOutdoorAirinCooling=Toggle(False),
    AllOutdoorAirinHeating=Toggle(False),
    CentralHeatingDesignSupplyAirTemperature="40",
    MinimumSystemAirFlowRatio="1",
    DataFieldSetType="Ironbug.HVAC.IB_SizingSystem_FieldSet")
duplicate_2 = Ironbug_Duplicate(Reference=coilclndx1, Amount=lng_2)  # -> graft(Objects), port
duplicate_3 = Ironbug_Duplicate(Reference=coilhtngas, Amount=lng_2)  # -> graft(Objects), port
duplicate_4 = Ironbug_Duplicate(Reference=oasystem, Amount=lng_2)  # -> graft(Objects), port
duplicate_5 = Ironbug_Duplicate(Reference=fanconstant, Amount=lng_2)  # -> graft(Objects), port
spm_szreheat = Ironbug_SetpointManagerSingleZoneReheat(ControlZone=graft, MinTemperature="-20", MaxTemperature="100")
merge = Merge(Data1=duplicate_4.Objects, Data2=duplicate_2.Objects, Data3=duplicate_3.Objects, Data4=duplicate_5.Objects)  # -> simplify(Result)
airloopbranches = AirLoopBranches(Branch1=graft)
sizingsystem = Ironbug_SizingSystem(Parameters_=objparams_3)
merge_2 = Merge(Data1=simplify(merge), Data2=simplify(spm_szreheat))
airloop = Ironbug_AirLoopHVAC(Supply=merge_2, Demand=airloopbranches, SizingSystem=sizingsystem)
hvacsystem_2 = Ironbug_HVACSystem(AirLoops=flatten(airloop))

toggle = BooleanToggle(False)
toggle_2 = BooleanToggle(False)
exporttoopenstudio = Honeybee_ExportToOpenStudio(
    epwWeatherFile=epw_stat.epwFile,
    HBZones=flatten(glazingcreator.HBObjWGLZ),
    writeOSM=toggle,
    runSimulation=toggle,
    fileName="IB_Sys")  # -> readMe, osmFileAddress, idfFileAddress, resultFileAddress, eioFileAddress, rddFileAddress, htmlReport, studyFolder, model; plug-in component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
exporttoopenstudio_2 = Honeybee_ExportToOpenStudio(
    epwWeatherFile=epw_stat.epwFile,
    HBZones=flatten(hvacsystem.HBZones),
    writeOSM=toggle_2,
    runSimulation=toggle_2,
    fileName="HB_Sys")  # -> readMe, osmFileAddress, idfFileAddress, resultFileAddress, eioFileAddress, rddFileAddress, htmlReport, studyFolder, model; plug-in component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
readepresult = Honeybee_ReadEPResult(resultFileAddress=exporttoopenstudio_2.resultFileAddress)  # -> totalThermalLoad, thermalLoadBalance, cooling, heating, electricLight, electricEquip, fanElectric, pumpElectric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; plug-in component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
panel_4 = Panel(exporttoopenstudio_2.osmFileAddress)
c_script = CSharpScript(x=exporttoopenstudio.osmFileAddress, Reference="C:\openstudio-2.5.0\CSharp\openstudio\OpenStudio.dll")  # -> out, A; inputs x: String; disabled
# ---------- c_script: C# ----------
    if (!string.IsNullOrEmpty(x))
    {
      var p = new OpenStudio.Path(x);
      var m = OpenStudio.Model.load(p).get();
      var plantLps = m.getPlantLoops();
      foreach (OpenStudio.PlantLoop pl in plantLps)
      {
        
        var tp = pl.sizingPlant().loopType();
        Print(pl.nameString() + "_" + tp);
      }
    }
# ---------- end c_script ----------
readepresult_2 = Honeybee_ReadEPResult(resultFileAddress=exporttoopenstudio.resultFileAddress)  # -> totalThermalLoad, thermalLoadBalance, cooling, heating, electricLight, electricEquip, fanElectric, pumpElectric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; plug-in component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
panel_5 = Panel(exporttoopenstudio.osmFileAddress)
panel_6 = Panel(exporttoopenstudio_2.readMe)
strnum = Ladybug_SeparateData(inputList=flatten(readepresult.cooling))  # -> numbers, strings; plug-in component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
strnum_2 = Ladybug_SeparateData(inputList=flatten(readepresult.heating))  # -> numbers, strings; plug-in component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
strnum_3 = Ladybug_SeparateData(inputList=flatten(readepresult_2.cooling))  # -> numbers, strings; plug-in component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
strnum_4 = Ladybug_SeparateData(inputList=flatten(readepresult_2.heating))  # -> numbers, strings; plug-in component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
ma = MassAddition(Input=flatten(strnum.numbers))  # -> Result, PartialResults
ma_2 = MassAddition(Input=strnum_2.numbers)  # -> Result, PartialResults
ma_3 = MassAddition(Input=flatten(strnum_3.numbers))  # -> Result, PartialResults
ma_4 = MassAddition(Input=strnum_4.numbers)  # -> Result, PartialResults
panel_7 = Panel(ma_2.Result)
panel_8 = Panel(ma.Result)
panel_9 = Panel(ma_4.Result)
panel_10 = Panel(ma_3.Result)
